# Dynamo graph Class-assignment.dyn (Dynamo 2.1.0.7500)

# group: Get elements
categories = Categories("OST_PipeCurves")  # graph input
all_elements_of_category = ElementsOfCategory(Category=categories)

# group: Generate triples
instance_namespace = CodeBlock { "http://localhost:3000/duplex/arch/pipes/"; }
class_namespace = CodeBlock { ["fso", "https://w3id.org/fso#"]; }
class_ = CodeBlock { "fso:Pipe"; }
# note: [0]Instance namespace
# [1]Class namespace
# [2]Class
# [3]Elements
assign_class = Python(IN[0]=instance_namespace, IN[1]=class_namespace, IN[2]=class_, IN[3]=all_elements_of_category)
# ---------- assign_class.python (16 lines) ----------
#The inputs to this node will be stored as a list in the IN variables.
instNS = IN[0]
clPFX = IN[1][0]
clNS = IN[1][1]
cl = IN[2]
elements = IN[3]

# PREFIXES
str = "@prefix inst: <%s> .\n" % instNS
str+= "@prefix %s: <%s> .\n\n" % (clPFX, clNS)

# INSTANCES
for e in elements:
	str+= "inst:%s a %s .\n" % (e.UniqueId, cl)

OUT = str
# ----------------------------------------

watch = Watch(assign_class)

# group: Write to file
file_path = Filename(".\1. class-pipes.ttl.txt")
writeText = FileSystem.WriteText(filePath=file_path, text=watch)

string = StringInput("http://localhost:3000/1111/opm-upload/class-assignment")
byUrl = DynaWeb.WebRequest.ByUrl()  # unwired: url
string_2 = StringInput("POST")
setMethod = DynaWeb.WebRequest.SetMethod(webRequest=byUrl, method=string_2)
string_3 = StringInput("Content-Type")
string_4 = StringInput("application/form-data")
addHeader = DynaWeb.WebRequest.AddHeader(webRequest=setMethod, name=string_3, value=string_4)
string_5 = StringInput("file")
string_6 = StringInput("application/x-turtle")
addFile = DynaWeb.WebRequest.AddFile(webRequest=addHeader, name=string_5, path=file_path, contentType=string_6)
execute = DynaWeb.WebRequest.Execute(request=addFile)
headers = DynaWeb.WebResponse.Headers(webResponse=execute)
content = DynaWeb.WebResponse.Content(webResponse=execute)
watch_2 = Watch(content)
byUrl_2 = DynaWeb.WebRequest.ByUrl()  # unwired: url
string_7 = StringInput("POST")
setMethod_2 = DynaWeb.WebRequest.SetMethod(webRequest=byUrl_2, method=string_7)
string_8 = StringInput("Content-Type")
string_9 = StringInput("application/form-data")
addHeader_2 = DynaWeb.WebRequest.AddHeader(webRequest=setMethod_2, name=string_8, value=string_9)
string_10 = StringInput("file")
string_11 = StringInput("application/x-turtle")
string_12 = StringInput("http://localhost:3000/1111/opm-upload/class-assignment")

# group: Get elements
categories_2 = Categories("OST_PipeFitting")  # graph input
all_elements_of_category_2 = ElementsOfCategory(Category=categories_2)

# group: Generate triples
instance_namespace_2 = CodeBlock { "http://localhost:3000/duplex/arch/fittings/"; }
class_namespace_2 = CodeBlock { ["fso", "https://w3id.org/fso#"]; }
class_2 = CodeBlock { "fso:Fitting"; }
# note: [0]Instance namespace
# [1]Class namespace
# [2]Class
# [3]Elements
assign_class_2 = Python(IN[0]=instance_namespace_2, IN[1]=class_namespace_2, IN[2]=class_2, IN[3]=all_elements_of_category_2)  # same code as assign_class

watch_3 = Watch(assign_class_2)

# group: Write to file
file_path_2 = Filename(".\1. class-fittings.ttl.txt")
writeText_2 = FileSystem.WriteText(filePath=file_path_2, text=watch_3)

addFile_2 = DynaWeb.WebRequest.AddFile(webRequest=addHeader_2, name=string_10, path=file_path_2, contentType=string_11)
execute_2 = DynaWeb.WebRequest.Execute(request=addFile_2)
content_2 = DynaWeb.WebResponse.Content(webResponse=execute_2)
watch_4 = Watch(content_2)
headers_2 = DynaWeb.WebResponse.Headers(webResponse=execute_2)
byUrl_3 = DynaWeb.WebRequest.ByUrl()  # unwired: url
string_13 = StringInput("POST")
setMethod_3 = DynaWeb.WebRequest.SetMethod(webRequest=byUrl_3, method=string_13)
string_14 = StringInput("Content-Type")
string_15 = StringInput("application/form-data")
addHeader_3 = DynaWeb.WebRequest.AddHeader(webRequest=setMethod_3, name=string_14, value=string_15)
string_16 = StringInput("file")
string_17 = StringInput("application/x-turtle")
string_18 = StringInput("http://localhost:3000/1111/opm-upload/class-assignment")

# group: Get elements
categories_3 = Categories("OST_MechanicalEquipment")  # graph input
all_elements_of_category_3 = ElementsOfCategory(Category=categories_3)

code_block = CodeBlock { 1; }
getItemAtIndex = List.GetItemAtIndex(list=all_elements_of_category_3, index=code_block)
list_create = List.Create(item0=getItemAtIndex)

# group: Generate triples
instance_namespace_3 = CodeBlock { "http://localhost:3000/duplex/arch/heaters/"; }
class_namespace_3 = CodeBlock { ["fso", "https://w3id.org/fso#"]; }
class_3 = CodeBlock { "fso:Heater"; }
# note: [0]Instance namespace
# [1]Class namespace
# [2]Class
# [3]Elements
assign_class_3 = Python(IN[0]=instance_namespace_3, IN[1]=class_namespace_3, IN[2]=class_3, IN[3]=list_create)  # same code as assign_class

watch_5 = Watch(assign_class_3)

# group: Write to file
file_path_3 = Filename(".\1. class-heaters.ttl.txt")
writeText_3 = FileSystem.WriteText(filePath=file_path_3, text=watch_5)

addFile_3 = DynaWeb.WebRequest.AddFile(webRequest=addHeader_3, name=string_16, path=file_path_3, contentType=string_17)
execute_3 = DynaWeb.WebRequest.Execute(request=addFile_3)
content_3 = DynaWeb.WebResponse.Content(webResponse=execute_3)
watch_6 = Watch(content_3)
headers_3 = DynaWeb.WebResponse.Headers(webResponse=execute_3)
byUrl_4 = DynaWeb.WebRequest.ByUrl()  # unwired: url
string_19 = StringInput("POST")
setMethod_4 = DynaWeb.WebRequest.SetMethod(webRequest=byUrl_4, method=string_19)
string_20 = StringInput("Content-Type")
string_21 = StringInput("application/form-data")
addHeader_4 = DynaWeb.WebRequest.AddHeader(webRequest=setMethod_4, name=string_20, value=string_21)
string_22 = StringInput("file")
string_23 = StringInput("application/x-turtle")
string_24 = StringInput("http://localhost:3000/1111/opm-upload/class-assignment")
code_block_2 = CodeBlock { 0; }
getItemAtIndex_2 = List.GetItemAtIndex(list=all_elements_of_category_3, index=code_block_2)
list_create_2 = List.Create(item0=getItemAtIndex_2)

# group: Generate triples
instance_namespace_4 = CodeBlock { "http://localhost:3000/duplex/arch/plants/"; }
class_namespace_4 = CodeBlock { ["fso", "https://w3id.org/fso#"]; }
class_4 = CodeBlock { "fso:Plant"; }
# note: [0]Instance namespace
# [1]Class namespace
# [2]Class
# [3]Elements
assign_class_4 = Python(IN[0]=instance_namespace_4, IN[1]=class_namespace_4, IN[2]=class_4, IN[3]=list_create_2)  # same code as assign_class

watch_7 = Watch(assign_class_4)

# group: Write to file
file_path_4 = Filename(".\1. class-plants.ttl.txt")
writeText_4 = FileSystem.WriteText(filePath=file_path_4, text=watch_7)

addFile_4 = DynaWeb.WebRequest.AddFile(webRequest=addHeader_4, name=string_22, path=file_path_4, contentType=string_23)
execute_4 = DynaWeb.WebRequest.Execute(request=addFile_4)
content_4 = DynaWeb.WebResponse.Content(webResponse=execute_4)
watch_8 = Watch(content_4)
headers_4 = DynaWeb.WebResponse.Headers(webResponse=execute_4)
string_from_object = FromObject(obj=all_elements_of_category_3)
python_script = Python(IN[0]=string_from_object)
# ---------- python_script.python (14 lines) ----------
# Load the Python Standard and DesignScript Libraries
import sys
import clr
clr.AddReference('ProtoGeometry')
from Autodesk.DesignScript.Geometry import *

# The inputs to this node will be stored as a list in the IN variables.


c = IN[0]

heater = [s for s in c if "kW" in s]
# Assign your output to the OUT variable.
OUT = heater
# ----------------------------------------
watch_9 = Watch(python_script)
