# Dynamo graph Class-propery-assignment.dyn (Dynamo 2.1.0.7500)

# group: Get element types used in model
categories = Categories("OST_MechanicalEquipment")  # graph input
all_elements_of_category = ElementsOfCategory(Category=categories)

lastItem = List.LastItem(list=all_elements_of_category)

# group (continued): Get element types used in model
type = archilab.Revit.Elements.Elements.Type(element=lastItem)
uniqueItems = List.UniqueItems(list=type)

# group: Get property
code_block = CodeBlock { "temperatureSetpoint"; }
getParameterValueByName = Element.GetParameterValueByName(element=uniqueItems, parameterName=code_block)

# group: Generate triples
class_namespace = CodeBlock { "http://localhost:3000/duplex/arch/ontology/"; }
property_namespace = CodeBlock { ["props", "https://w3id.org/props#"]; }
property = CodeBlock { "props:temperatureSetpoint"; }
datatype_namespace = CodeBlock { ["xsd", "http://www.w3.org/2001/XMLSchema#"]; }
datatype = CodeBlock { "xsd:decimal"; }
# note: [0]Instance namespace
# [1]Property namespace
# [2]Property
# [3]Datatype namespace
# [4]Datatype
# [5]Elements
# [6]Properties
assign_property = Python(IN[0]=class_namespace, IN[1]=property_namespace, IN[2]=property, IN[3]=datatype_namespace, IN[4]=datatype, IN[5]=uniqueItems, IN[6]=getParameterValueByName, IN[7]=lastItem)
# ---------- assign_property.python (37 lines) ----------
import sys
sys.path.append(r'C:\Program Files (x86)\IronPython 2.7\Lib')
import urllib

#The inputs to this node will be stored as a list in the IN variables.
classNS = IN[0]
propPFX = IN[1][0]
propNS = IN[1][1]
prop = IN[2]
dtPFX = IN[3][0]
dtNS = IN[3][1]
dt = IN[4]
elements = IN[5]
properties = IN[6]
uni = IN[7]

def _get_id_name(e):
	# Make lowercase and replace æ, ø, å
	n = e.Name.lower()
	n = n.replace('æ', 'ae').replace('ø', 'oe').replace('å', 'aa')
	# Make PascalCaseName
	n = ''.join(x for x in n.title() if x.isalnum())
	# URL encode
	n = urllib.quote(n)
	return n

# PREFIXES
str = "@prefix ont: <%s> .\n" % classNS
str+= "@prefix %s: <%s> .\n" % (propPFX, propNS)
str+= "@prefix %s: <%s> .\n\n" % (dtPFX, dtNS)

# INSTANCES
for i, e in enumerate(elements):
	classId = _get_id_name(e)
	str+= 'inst:%s %s "%s"^^%s .\n' % (classId, prop, properties[i], dt)
str= 'inst:%s %s "%s"^^%s .\n' % (uni.UniqueId, prop, properties[i], dt)
OUT = str
# ----------------------------------------

watch = Watch(assign_property)

# group: Write to file
file_path = Filename("Class-propery-assignment.dyn")
writeText = FileSystem.WriteText(filePath=file_path, text=watch)

byUrl = DynaWeb.WebRequest.ByUrl()  # unwired: url
string = StringInput("POST")
setMethod = DynaWeb.WebRequest.SetMethod(webRequest=byUrl, method=string)
string_2 = StringInput("Content-Type")
string_3 = StringInput("application/form-data")
addHeader = DynaWeb.WebRequest.AddHeader(webRequest=setMethod, name=string_2, value=string_3)
string_4 = StringInput("file")
string_5 = StringInput("application/x-turtle")
addFile = DynaWeb.WebRequest.AddFile(webRequest=addHeader, name=string_4, path=file_path, contentType=string_5)
execute = DynaWeb.WebRequest.Execute(request=addFile)
content = DynaWeb.WebResponse.Content(webResponse=execute)
watch_2 = Watch(content)
headers = DynaWeb.WebResponse.Headers(webResponse=execute)
string_6 = StringInput("http://localhost:3000/1111/opm-upload/class-property-assignment")
