# Dynamo graph ElementFeedsElement_SingleSystemSingleRadiator.dyn (Dynamo 2.1.0.7500)

# group: Get relationships
categories = Categories("OST_Rooms")  # graph input
all_elements_of_category = ElementsOfCategory(Category=categories)
categories_2 = Categories("OST_Doors")  # graph input
all_elements_of_category_2 = ElementsOfCategory(Category=categories_2)
code_block = CodeBlock { 0.7; }
getSurroundingElements = Custom[Tool.GetSurroundingElements](Element=all_elements_of_category, ElementCheck=all_elements_of_category_2, Tolerance=code_block)  # Get Surrounding Elements by Categories, group them as List. Tolerance distance available.

categories_3 = Categories("OST_PipingSystem")  # graph input
all_elements_of_category_3 = ElementsOfCategory(Category=categories_3)
elements_in_connected_network = Custom[Elements in connected network](Element=all_elements_of_category_3)  # Returns all elements that are physically connected to the input element
firstItem = List.FirstItem(list=elements_in_connected_network)
ꟿ_list_dropfirstlast = Custom[ꟿ List.DropFirstLast](list=firstItem)  # Removes the first and last items from the list
reverse = List.Reverse(list=ꟿ_list_dropfirstlast.F_L)
firstItem_2 = List.FirstItem(list=firstItem)
addItemToEnd = List.AddItemToEnd(item=firstItem_2, list=firstItem)
code_block_2 = CodeBlock { 1; }
flatten = List.Flatten(list=addItemToEnd, amt=code_block_2)
ꟿ_list_dropfirstlast_2 = Custom[ꟿ List.DropFirstLast](list=flatten)
watch = Watch(ꟿ_list_dropfirstlast_2.rest)
python_script = Python(IN[0]=flatten, IN[1]=watch)
# ---------- python_script.python (19 lines) ----------
# Load the Python Standard and DesignScript Libraries
import sys
import clr
clr.AddReference('ProtoGeometry')
from Autodesk.DesignScript.Geometry import *

# The inputs to this node will be stored as a list in the IN variables.
listA = IN[0]
listB = IN[1]

# Place your code below this line
#listA=[1,2,3,4,5]
#listB=[2,3,4]
#list3=list1+list2
#sorted =list3.sort()

ListeC = [item for pair in zip(listA, listB) for item in pair]
# Assign your output to the OUT variable.
OUT = ListeC
# ----------------------------------------
addItemToEnd_2 = List.AddItemToEnd(item=reverse, list=python_script)
code_block_3 = CodeBlock { 1; }
flatten_2 = List.Flatten(list=addItemToEnd_2, amt=code_block_3)
code_block_4 = CodeBlock { 2; }
chop = List.Chop(list=flatten_2, lengths=code_block_4)

# group: Generate triples
code_block_5 = CodeBlock { "http://localhost:3000/duplex/arch/flowSystems/"; }
# note: [0] Subject namespace
# [1] Object namespace
# [2] Relationships
python_script_2 = Python(IN[0]=code_block_5, IN[1]=chop)
# ---------- python_script_2.python (16 lines) ----------
instNS =		IN[0]	# Namespace to be used for space (ex http://someArchitect/projA/spaces/)
#elementNS =		IN[1]	# Namespace to be used for element (ex http://someArchitect/projA/doors/)
pipeConnections = 	IN[1]	# List of adjacencies

# PREFIXES
str = "@prefix inst: <%s> .\n" % instNS
str+= "@prefix fso: <https://w3id.org/flowSystem#> .\n\n"

for item in pipeConnections:
	fromPipe = item[0].UniqueId
	toPipe = item[1].UniqueId
	
	str+= 'inst:%s fso:feeds inst:%s .\n' % (fromPipe, toPipe)

#Assign your output to the OUT variable.
OUT = str
# ----------------------------------------

watch_2 = Watch(python_script_2)

# group: Write to file
file_path = Filename(".\SingleSystemSingleRoute")
writeText = FileSystem.WriteText(filePath=file_path, text=watch_2)

code_block_6 = CodeBlock { "http://localhost:3000/duplex/arch/windows/"; }
byUrl = DynaWeb.WebRequest.ByUrl()  # unwired: url
string = StringInput("POST")
setMethod = DynaWeb.WebRequest.SetMethod(webRequest=byUrl, method=string)
string_2 = StringInput("Content-Type")
string_3 = StringInput("application/form-data")
addHeader = DynaWeb.WebRequest.AddHeader(webRequest=setMethod, name=string_2, value=string_3)
string_4 = StringInput("file")
string_5 = StringInput("application/x-turtle")
addFile = DynaWeb.WebRequest.AddFile(webRequest=addHeader, name=string_4, path=file_path, contentType=string_5)
execute = DynaWeb.WebRequest.Execute(request=addFile)
content = DynaWeb.WebResponse.Content(webResponse=execute)
watch_3 = Watch(content)
headers = DynaWeb.WebResponse.Headers(webResponse=execute)
string_6 = StringInput("http://localhost:3000/1111/opm-upload/relationship-assignment")
mep_connector_info = Custom[MEP Connector info+](Element=categories_3)  # This node will return the connectors and a lot of information about those connectors of the input elements
watch_4 = Watch(python_script)
uniqueId = Element.UniqueId(element=watch_4)
